# Requirement set ShipRequirements (R2026a)

## 1 [#1] Platform Support
The vessel must provide the shipboard services and resources necessary to support vessel operations.
Rationale: The operator, crew, and owner require the vessel to provide the shipboard services and
resources necessary to conduct vessel operations.

### 1.1 [#2] Electrical Power
The vessel shall provide electrical power necessary to support vessel operations.
Rationale: Electrical power is required to operate propulsion, command and surveillance systems, auxiliary systems, outfitting systems, and mission-specific systems.

#### 1.1.1 [#3] Electrical Power Generation
Generator sets shall be configured to produce the electrical power demanded by the shipboard load schedule for each defined operating condition.
Rationale: Shipboard electrical loads require an onboard source of electrical power when shore-supplied power is unavailable.

#### 1.1.2 [#4] Electrical Power Distribution
The electrical power distribution interfaces shall distribute electrical power from sources to loads as designated in the shipboard load schedule.
Rationale: Generated, stored, or shore-supplied electrical power must be transferred to the systems and equipment that require it.

##### 1.1.2.1 [#46] Stored-Energy Supply
The stored-energy supply interfaces shall supply stored electrical energy to designated loads under defined operating conditions.
Rationale: Stored electrical energy supports designated shipboard loads during defined operating conditions in which immediate power from another source is unavailable or insufficient.

##### 1.1.2.2 [#47] Shore Power
The shore power interfaces shall accept and distribute shore-supplied electrical power for use by designated shipboard loads.
Rationale: Shore-supplied electrical power allows designated vessel services to operate without relying solely on onboard electrical generation while the vessel is connected to shore facilities.

#### 1.1.3 [#5] Electrical Energy Storage
The battery bank shall store electrical energy received from the shipboard electrical distribution system.
Rationale: Electrical energy must be stored so that it is available for later use during defined operating conditions.
(Assumption: Battery Energy Storage System (BESS) is the only electrical energy storage system being used (as opposed to electrostatic supercapacitors, FESS, and HESS)

#### 1.1.4 [#8] Load Power Continuity
Uninterruptible Power Supplies, Emergency Generators, and Power Management Systems shall maintain the electrical power supplied to critical and essential loads during each defined loss-of-power condition.
Rationale: Loss of electrical power to loads can prevent the vessel from maintaining safety-critical and mission-critical functions.

#### 1.1.5 [#9] Electrical Power Quality
Local automatic voltage regulator, governor, converter, and harmonic filter devices shall be used in tandem with central power management and transformer systems to regulate voltage, frequency, and waveform in accordance with the defined parameters.
Rationale: Shipboard equipment requires electrical power within defined operating limits to function correctly and avoid damage or loss of performance.

### 1.2 [#10] Machinery Fluid Services
The vessel shall provide the fluids required to support the operation of installed machinery.
Rationale: Installed machinery requires cooling media, lubrication oil, fuel oil, compressed air, and hydraulic fluid to perform the allocated functions.

#### 1.2.1 [#11] Cooling Fluid Services
The cooling fluid service shall remove and transport thermal energy from installed machinery to maintain its required operating temperature limits.
Rationale: Installed machinery generates thermal energy during operation that must be transferred to an appropriate heat sink to maintain reliable operation and prevent thermal degradation.

##### 1.2.1.1 [#19] Freshwater Cooling
The freshwater cooling service shall circulate coolant through closed-loop circuits to absorb thermal energy from designated machinery.
Rationale: Closed-loop freshwater cooling removes thermal energy directly from machinery while minimizing corrosion, contamination, and fouling of internal cooling passages.

#### 1.2.2 [#12] Lubrication Services
The lubrication service shall establish and maintain the lubricating conditions required for the operation of installed machinery.
Rationale: Relative motion between contacting mechanical surfaces generates friction and wear that must be controlled to ensure reliable machinery operation and acceptable component life.

#### 1.2.3 [#13] Fuel Oil Services
The fuel oil service shall administer the chemical energy required for the operation of installed fuel-consuming machinery.
Rationale: Prime movers and auxiliary fuel-consuming systems rely on the combustion of fuel to convert chemical energy into the mechanical energy required for mechanical and electrical power generation.

##### 1.2.3.1 [#14] Propulsion Machinery Fuel Oil Supply
The propulsion fuel oil service shall administer fuel oil to propulsion machinery to support the generation of propulsive power for vessel mobility and maneuvering.
Rationale: Propulsion machinery converts the chemical energy stored in fuel into mechanical power to propel and maneuver the vessel throughout its operating envelope.

##### 1.2.3.2 [#15] Auxiliary Machinery Fuel Oil Supply
The auxiliary power fuel oil service shall administer fuel oil to auxiliary power generation systems to support power generation for auxiliary services.
Rationale: Auxiliary power generation converts the chemical energy stored in fuel into the power required to support auxiliary services.

#### 1.2.4 [#17] Compressed Air Supply
The compressed air service shall generate, store, regulate, and administer compressed air to supply the pneumatic power required for the operation of installed machinery.
Rationale: Compressed air stores potential energy that is converted to pneumatic power for designated shipboard functions requiring controlled fluid pressure.

#### 1.2.5 [#21] Hydraulic Fluid Services
The hydraulic fluid service shall pressurize and circulate hydraulic fluid to transmit power to installed hydraulically actuated machinery.
Rationale: Hydraulically actuated machinery requires pressurized fluid to transmit power and produce controlled mechanical motion or force.

### 1.3 [#25] Thermal Management
The thermal management service shall regulate, recover, and reject thermal energy to maintain the thermal conditions required by installed equipment and machinery spaces.
Rationale: Installed equipment and operating machinery generate thermal energy that must be managed to prevent overheating, preserve required equipment performance, and maintain acceptable machinery-space conditions; thermal energy is recovered and reused when economically feasible.

#### 1.3.1 [#26] Thermal Environment Control
The thermal-environment-control service shall regulate the thermal conditions required within designated vessel spaces.
Rationale: Equipment performance, machinery reliability, and material integrity depend upon maintaining environmental temperatures within their specified operating limits.

##### 1.3.1.1 [#27] Machinery-Space Thermal Control
The machinery-space thermal-control service shall regulate the thermal conditions required within designated machinery spaces.
Rationale: Heat released by installed machinery must be managed to maintain acceptable operating conditions within machinery spaces.

##### 1.3.1.2 [#28] Equipment-Space Thermal Control
The equipment-space thermal-control service shall regulate the thermal conditions required within designated equipment spaces.
Rationale: Temperature-sensitive electrical, electronic, command, surveillance, and mission equipment require controlled thermal environments to maintain their performance and reliability.

#### 1.3.2 [#29] Thermal Energy Recovery
The thermal-energy-recovery service shall recover usable thermal energy from designated vessel heat sources.
Rationale: Thermal energy generated during vessel operation may be recovered and redirected to shipboard uses, reducing the demand for additional energy sources.

##### 1.3.2.1 [#31] Recovered Thermal Energy Utilization
The recovered-thermal-energy-utilization service shall transfer recovered thermal energy to designated shipboard thermal loads.
Rationale: Recovered thermal energy can satisfy shipboard heating demands that would otherwise require additional fuel or electrical power.

#### 1.3.3 [#32] Environmental Heat Rejection
The environmental heat-rejection service shall discharge thermal energy that cannot be beneficially utilized to available external heat sinks.
Rationale: Thermal energy that cannot be recovered for useful purposes must ultimately be rejected to prevent heat accumulation and sustain continuous vessel operation.

##### 1.3.3.1 [#35] Seawater Heat Rejection
The seawater heat-rejection service shall transfer thermal energy from designated vessel cooling circuits to the surrounding seawater.
Rationale: The seawater surrounding the vessel provides a high-capacity external heat sink for the sustained rejection of thermal energy generated during vessel operation.

##### 1.3.3.2 [#36] Air Heat Rejection
The air heat-rejection service shall transfer thermal energy from designated vessel systems to the surrounding atmosphere where atmospheric heat rejection is required.
Rationale: Ambient air provides an external heat sink for systems designed to reject thermal energy directly to the atmosphere.

#### 1.3.4 [#38] Thermal Energy Transfer
The thermal-energy-transfer service shall transfer thermal energy between designated thermal systems while maintaining the required separation of working media.
Rationale: Thermal energy must frequently be transferred between independent thermal systems without mixing the associated working media in order to support cooling, heating, recovery, and rejection processes.

### 1.4 [#39] Shipboard Water Services
The shipboard water services shall process, store, and distribute different grades of water according to end use.
Rationale: Water aboard ship supports both machinery and personnel through multiple water qualities and distribution networks.

#### 1.4.1 [#48] Freshwater Production
Freshwater production shall treat seawater intake through reverse osmosis or distillation such that the end product is desalinated.
(Assumption: for simplification, freshwater services intakes seawater only)
Rationale: Freshwater production onboard reduces the vessel's dependence on shore-side and bunkering replenishment.

#### 1.4.2 [#51] Freshwater Storage
The freshwater storage service shall retain freshwater in designated tanks while preserving the volume and water quality required for subsequent shipboard use.
Rationale: Freshwater must be retained between production or replenishment and consumption so that shipboard demand can be met despite variations in production rate, replenishment availability, and usage.
(Assumption: freshwater is not distributed to consumption outlets immediately after production and moved to tanks first instead)

#### 1.4.3 [#52] Machinery Makeup Water
The machinery makeup water service shall replenish freshwater losses within closed-loop machinery circuits.
Rationale: Closed-loop machinery systems such as cooling circuits gradually lose water through maintenance, leakage, venting, or sampling.

#### 1.4.4 [#53] Freshwater Distribution
The freshwater distribution service shall use pumps and valves configured in designated paths to convey freshwater to and from storage tanks at flow rates and pressures in accordance with the defined parameters.
Rationale: Freshwater tanks and consumers require controlled conveyance for storage safety, point-of-use safety, and practical use.

#### 1.4.5 [#55] Potable Water Production
Potable water production shall treat freshwater intake through remineralization, pH adjustment, and disinfection such that the end product is potable.
(Assumption: for simplification, potable water services intakes freshwater only)
Rationale: Personnel require potable water for drinking, food preparation, and hygiene.

#### 1.4.6 [#56] Potable Water Storage
The potable storage service shall retain freshwater in designated tanks while preserving the volume and water quality required for subsequent shipboard use.
Rationale: Potable water must be retained between production or replenishment and consumption so that shipboard demand can be met despite variations in production rate, replenishment availability, and usage.
(Assumption: potable water is not distributed to consumption outlets immediately after production and moved to tanks first instead)

#### 1.4.7 [#57] Potable Water Distribution
The potable water distribution service shall use pumps and valves configured in designated paths to convey freshwater to and from storage tanks at flow rates and pressures in accordance with the defined parameters.
Rationale: Potable water tanks and consumers require controlled conveyance to ensure storage safety, point-of-use safety, and practical use.

### 1.5 [#61] Waste Management
The waste-management service shall control the collection, segregation, processing, retention, and disposition of waste streams generated during vessel operation.
Rationale: Vessel operation generates waste streams with differing physical and chemical properties, hazards, processing needs, and discharge restrictions that must be managed to protect personnel, equipment, the vessel, and the surrounding environment.

#### 1.5.1 [#72] Oily Waste Management
The oily-waste-management service shall collect, separate, monitor, retain, and dispose of oily mixtures and oil residues generated by machinery-space operations.
Rationale: Machinery operation generates oily bilge water and oil residues that require controlled handling to prevent marine pollution.
Basis: MARPOL Annex I (Prevention of Pollution by Oil)

#### 1.5.2 [#73] Sewage Management
The sewage-management service shall collect, treat, retain, and dispose of sewage generated aboard the vessel.
Rationale: Sewage requires controlled treatment and disposition to protect personnel health and the marine environment.
Basis: MARPOL Annex IV (Prevention of Pollution by Sewage from Ships)

#### 1.5.3 [#74] Garbage Management
The garbage-management service shall collect, segregate, process, retain, and dispose of ship-generated garbage according to its material category.
Rationale: Different garbage categories require different handling methods to support environmental compliance and efficient vessel operation.
Basis: MARPOL Annex V (Prevention of Pollution by Garbage from Ships)

### 1.6 [#75] Atmospheric Management
The atmospheric management service shall maintain the atmospheric conditions required to support personnel, installed equipment, and vessel operations.
Rationale: The vessel atmosphere must be continuously managed to maintain acceptable air quality, ventilation, contaminant control, and other atmospheric conditions necessary for safe, healthy, and reliable vessel operation.

#### 1.6.1 [#76] Ventilation
Ventilation shall circulate and exchange air within designated vessel spaces to maintain the defined air quality parameters for that space.
Rationale: Air circulation and ventilation distribute fresh air, remove contaminants, prevent stagnant air, and maintain acceptable atmospheric conditions throughout occupied and designated equipment spaces.

#### 1.6.2 [#77] Hazardous Gases Management
Hazardous gases management shall detect, isolate, and mitigate hazardous atmospheric conditions generated during vessel operation.
Rationale: Machinery operation, fuel handling, cargo operations, and onboard processes may generate hazardous atmospheres that require detection and mitigation to protect personnel, equipment, and the vessel.

#### 1.6.3 [#78] Emissions Management
Emissions Management shall control atmospheric emissions generated during vessel operation in accordance with applicable environmental regulations.
Rationale: Propulsion machinery, auxiliary machinery, incineration equipment, and other onboard processes generate atmospheric emissions that require control to reduce environmental impact and satisfy applicable emission regulations.
Basis: MARPOL Annex VI

### 1.7 [#79] Habitability and Ergonomics

#### 1.7.1 [#80] Consumables Storage

#### 1.7.2 [#81] Domestic Water Use

#### 1.7.3 [#106] Lighting

## 2 [#86] Mission Systems Support
The vessel must deploy the mission-specific systems necessary to perform mission operations.
(Assumption: disregard lifecycle considerations for simplicity)
Rationale: Mission accomplishment depends on the operability of mission systems.

### 2.1 [#87] Mission Systems Integration
Mission systems integration shall unite mission systems with the platform through interfaces and standardized physical connections.
Rationale: The operability of mission systems depends on their connectivity with the platform, such that the exchange of physical resources and information necessary for mission operations may occur.

### 2.2 [#88] Mission Systems Operation
Control systems shall execute commands issued by designated human and automated operators.
Rationale: For the equipment associated with the mission system to serve its intended purposes, operators must be able to command equipment behavior.

### 2.3 [#89] Mission Information
Cyber-physical systems shall generate and report mission information by running information processing cycles.
Rationale: Information allows an operator to be certain that the command they issue instructs appropriate control.

### 2.4 [#90] Mission Communications
Authorized entities shall exchange mission information on the basis of interface-specific network protocols.
Rationale: Mission-system operation depends upon the timely exchange of mission information between participating entities.

### 2.5 [#91] Mission Resources
Physical gradients and system requests shall route vessel resources through mission-systems-to-platform interfaces.
Rationale: Mission systems require platform resources to perform their intended operational functions.

## 3 [#95] Safety and Survivability
The vessel must protect personnel, mission systems, and the platform from hazards encountered during routine operations while maintaining the ability to withstand and recover from foreseeable emergency conditions and failures.
Rationale: Personnel safety, mission accomplishment, and preservation of the vessel depend upon preventing hazards during normal operation and maintaining essential capabilities during failures and emergency conditions.

### 3.1 [#96] Operational Hazard Control

#### 3.1.1 [#98] Hazardous Materials Management

#### 3.1.2 [#99] Guarding and Shielding

#### 3.1.3 [#100] Fail-Safe Mechanisms

### 3.2 [#101] Fire Suppression

#### 3.2.1 [#102] Fire Zoning

#### 3.2.2 [#103] Fire SCADA

#### 3.2.3 [#104] Fire Extinguishment

### 3.3 [#105] Flood Protection

#### 3.3.1 [#107] Sealed Integrity

#### 3.3.2 [#109] Equalization
(cross-flooding and counter-flooding)

#### 3.3.3 [#110] Flooding SCADA

#### 3.3.4 [#111] Dewatering

### 3.4 [#112] Critical Function Continuity

#### 3.4.1 [#113] Critical Function Independence

#### 3.4.2 [#114] Emergency Service Supply

#### 3.4.3 [#115] Degraded Operation

### 3.5 [#116] Evacuability

#### 3.5.1 [#117] Survival Craft

### 3.6 [#118] Casualty Response

#### 3.6.1 [#119] Casualty SCADA

#### 3.6.2 [#120] Essential Function Recovery

## 4 [#121] Seakeeping and Stability
The vessel must remain stable and safe throughout the range of loading conditions and environmental conditions expected during its intended operations.
Rationale: Vessel safety, operational capability, and the uncompromised transportation of cargo depend on maintaining acceptable equilibrium and motion response as weight distribution, fluid loading, mission configuration, and environmental conditions vary.

### 4.1 [#122] Loading Condition

#### 4.1.1 [#123] Design Loading Conditions
Still water moments, shear forces, and dynamic wave loading shall be evaluated for the fully loaded departure, fully loaded arrival, departure ballast, and arrival ballast conditions.
Rationale: Defined loading states provide repeatable analysis cases of vessel loading and operation.

### 4.2 [#124] Weight Distribution
Each mass loaded on to the vessel shall be assigned a location based on the effect of its weight as modeled along the vertical, longitudinal, and transverse axes of distribution in the lightship and deadweight conditions.
Rationale: The longitudinal, transverse, and vertical distribution of vessel weight determines equilibrium attitude, center-of-gravity position, and righting characteristics.

#### 4.2.1 [#126] Lightship Weight

#### 4.2.2 [#127] Variable Load

#### 4.2.3 [#128] Center of Gravity

### 4.3 [#125] Fluid Loading
The allocation of fluid to tanks shall be informed by the effects of the distributed volumes as modeled for each design loading condition.
Rationale: Tank contents affect displacement, trim, center of gravity, free-surface effects, and the vessel’s response to environmental excitation.

#### 4.3.1 [#129] Free-Surface Effect
The impact of partially filled tanks on the metacentric height of the vessel shall be determined using free-surface correction.
Rationale: Fluid movement within a partially filled tank can reduce effective stability and alter dynamic response.

### 4.4 [#130] Mission Systems Confirguration
The arrangement of mission systems shall be approved based on the weight and center of gravity associated with each configuration
Mission-configuration properties shall specify the weight and center-of-gravity data associated with each approved mission-system configuration.
The configuration in which mission systems are installed shall be informed by how the arrangement affects vessel stability for each design loading condition.
Rationale: Mass properties like weight and center of gravity determine vessel displacement, weight distribution, and motion characteristics.

### 4.5 [#131] Loading Condition Coverage
The limiting loading states shall be identified in the intended operating envelope.
Rationale: Possible critical loading conditions must be defined in addition to the loaded conditions of routine operations.

## 5 [#132] Endurance
The vessel must sustain operations for the duration, range, and operational tempo required by its intended operational roles.
Rationale: Mission accomplishment depends on the continued availability of propulsion, electrical power, mission systems, and essential ship services throughout the intended operating profile. Insufficient endurance may restrict operational range, reduce mission persistence, interrupt the required operating tempo, or require premature replenishment or mission termination. Endurance must therefore be evaluated against defined operating conditions, consumable-resource availability, expected resource demand, and required operational reserves.

### 5.1 [#133] Fuel Storage
The fuel storage system shall have a usable fuel storage capacity that matches the sum of the operational consumption and the reserve.
(NOTE: this requirement is purely functional since it's qualitative--the decomposition hierarchy could be made more compact such that this functional requirement is replaced with a performance requirement which states that "the usable fuel storage capacity shall be at least X MT).
Rationale: The fuel storage system establishes the upper limit on the quantity of usable fuel that can be carried onboard. Adequate usable storage capacity is necessary to support the required mission endurance while accommodating operational fuel reserves and expected fuel consumption throughout the mission profile.

#### 5.1.1 [#134] Usable Fuel Capacity
The usable fuel storage capacity shall be greater than or equal to the total fuel quantity required to complete the mission endurance profile.
(NOTE: "mission endurance profile" is an abstract quantity such that this phrasing acts as a placeholder for an actual value)
Rationale: The usable fuel capacity is the amount of fuel available to support propulsion and shipboard services throughout the required mission endurance profile, accounting for unusable fuel and operational reserve requirements.

#### 5.1.2 [#135] Reserve Fuel Quantity
The usable fuel remaining after completion of the mission endurance profile shall be greater than or equal to the fuel required for the defined reserve operating profile.
(NOTE: The percentage that defines a reserve fuel quantity must still be determined)
Rationale: Completion of the planned operating profile does not eliminate the possibility of delays, route deviations, adverse environmental conditions, equipment casualties, or other contingencies. Maintaining a defined reserve fuel quantity ensures sufficient fuel remains to support continued propulsion, electrical power generation, and essential ship-service functions until the vessel reaches a refueling opportunity.

#### 5.1.3 [#136] Fuel-Type Capacity Allocation
The usable storage capacity allocated to each fuel type shall be greater than or equal to the sum of the operational fuel requirement and reserve fuel requirement for that fuel type.
Rationale: Aggregate fuel capacity does not demonstrate endurance when fuel-consuming systems require different fuels. Capacity must therefore be allocated by fuel type so that each fuel-dependent propulsion, electrical-generation, or mission system has access to the quantity needed standard and reserve operating profiles.

### 5.2 [#137] Fuel Delivery
The fuel system shall deliver each required fuel type to the active fuel-consuming systems.
Rationale: Fuel carried onboard contributes to endurance only if it can be delivered to the systems that consume it. Continuous delivery of the required fuel type to propulsion, electrical generation, and other fuel-consuming ship systems enables sustained operation.

#### 5.2.1 [#138] Fuel Transfer
The fuel system shall transfer each required fuel type from fuel storage to the fuel conditioning subsystem.
Rationale: Fuel stored onboard is not available to fuel-consuming systems until it can be transferred from storage to downstream fuel-system functions. Fuel transfer establishes the first stage of the fuel-delivery process by making stored fuel available for conditioning, distribution, and subsequent consumption.

#### 5.2.2 [#139] Fuel Conditioning
Fuel conditioning shall maintain each fuel stream within the property limits specified at the inlet of its assigned fuel consumer.
Rationale: Fuel-consuming equipment depends on fuel entering at conditions compatible with its combustion and fuel-handling requirements. Fuel outside the specified limits can degrade equipment performance, interrupt fuel consumption, or make part of the stored fuel inventory unavailable for mission operations.

##### 5.2.2.1 [#140] Flow Capacity Requirement
The active fuel-conditioning configuration shall accommodate a fuel flow rate no less than the aggregate demand of its downstream active consumers.
(NOTE: Although phrased ambiguously, this is a quantitative requirement, but it will not be verified since the fuelAnalysis script isn't written for this verification.)
Rationale: Sizing the conditioning equipment to meet the aggregate operational fuel demand ensures conditioned fuel is continuously available for propulsion, electrical generation, and other fuel-consuming systems during the intended operating profile.

#### 5.2.3 [#141] Fuel Routing
Fuel distribution shall route each required fuel type via the corresponding piping circuit from fuel conditioning to each active downstream fuel consumer.
Rationale: Conditioned fuel must be directed to consumers in accordance with the selected operating configuration.

#### 5.2.4 [#142] Consumer Fuel Supply
At each piping-to-consumer interface, the fuel supply system shall deliver fuel at the set pressure and temperature within the specified inlet operating limits of the receiving fuel-consuming equipment.
Rationale: For the consumer to accept and use the fuel supplied by the fuel delivery system, the fuel must have the intensive physical properties that allow for injection.
NOTE: We have not yet defined what the acceptable fuel delivery conditions are for the fuel to be used by the active consumer.

### 5.3 [#144] Fuel Consumption
The aggregate amount of fuel demanded by the active fuel-consuming subsystems per the selected fueling configuration shall be less than or equal to the amount of fuel available to that fueling profile.
Rationale: Evaluating aggregate demand prevents the fuel allocation to individual subsystems from exceeding the vessel's overall operational fuel budget.

#### 5.3.1 [#145] Active Consumer Fuel Demand
Each active fuel-consuming subsystem shall maintain its fuel-consumption rate within the limit assigned to the applicable operating state.
Rationale: Fuel demand varies with the operating state and active equipment configuration. Limiting each consumer's fuel-consumption rate establishes the component-level demand needed to calculate aggregate fuel consumption and evaluate mission endurance.

#### 5.3.2 [#146] Aggregate Fuel Demand
Aggregate fuel demand shall equal the sum of the fuel-consumption rates assigned to all active fuel-consuming subsystems in the applicable operating state.
(TO DO: this statement seems to describe the calculation and not the ship--how can we modify this?)
Rationale: Mission fuel consumption cannot be determined from an individual consumer alone. Summing the demands of the active propulsion, electrical-generation, and mission-system consumers establishes the total fuel-consumption rate associated with the selected vessel configuration and operating state.

#### 5.3.3 [#147] Operating-Profile Fuel Consumption
The amount of fuel available to a given operating profile shall match the amount of fuel that is actually consumed over that operating profile.
The vessel shall complete the defined mission operating profile without consuming more fuel than the amount allocated to that operating profile.
The amount of fuel that is actually consumed over the mission profile
Rationale: The quantity of fuel consumed during mission execution depends on both the operating profile and the active fuel-consuming systems. Limiting fuel consumption to the quantity allocated for the operating profile ensures that planned operations can be completed without prematurely exhausting the fuel assigned to that portion of the mission.